# Grasshopper definition sound-vase.gh (Grasshopper 1.0.7)
# Copyright: GNU General Public License 3.0
# plug-ins: MosquitoAudio2

# ---- group: vase from audio
# sound vase
# mosquito plugin
path = FilePath("D:\waveforms\loveform\audio\persian.mp3")
x_offset = Slider(0.25, range=0..1)
skip = Slider(450, range=0..5000)
stop = Slider(150, range=0..10000)
start = Slider(125, range=0..10000)
Z = Slider(15, range=0..100)
radius = Panel("5 To 6")
audiowave = AudioWave(AudioFile=path, XOffset=x_offset, Skip=skip)  # -> Peak, Points, Length
play = AudioPlay(AudioFile=path, Boolean=Toggle(False))
split_list = SplitList(List=audiowave.Points, Index=stop)  # -> ListA, ListB
split_list_2 = SplitList(List=split_list.ListA, Index=start)  # -> ListA, ListB
deconstruct = Deconstruct(Point=split_list_2.ListB)  # -> XComponent, YComponent, ZComponent
bounds = Bounds(Numbers=deconstruct.XComponent)
bounds_2 = Bounds(Numbers=deconstruct.ZComponent)
remap_numbers = RemapNumbers(Value=deconstruct.XComponent, Source=bounds, Target=Z)  # -> Mapped, Clipped
remap_numbers_2 = RemapNumbers(Value=deconstruct.ZComponent, Source=bounds_2, Target=radius)  # -> Mapped, Clipped
construct_point = ConstructPoint(XCoordinate=0, YCoordinate=0, ZCoordinate=remap_numbers.Mapped)
circle = Circle(Plane=construct_point, Radius=remap_numbers_2.Clipped)
loft = Loft(Curves=circle, Options={Adjust=False, Closed=False, LoftEnds=0, LoftSimp=0, LoftType=0, Rebuild=10, Refit=0.01})
