# Grasshopper definition space-filling-vase.gh (Grasshopper 1.0.7)

point_spacing = Slider(1, range=0..1)
scale_factor = Slider(0.7, range=0..1)
count = Slider(3, range=0..10)
seed = Slider(475, range=0..1000)
offset = Slider(3, range=0..10)
amplitude = Slider(0.15, range=0..1)
seed_2 = Slider(2, range=0..10)
# space filling curve
radius = Slider(36, range=0..100)
space_filling_curve = SpaceFillingCurve(
    radius=radius,
    factor=scale_factor,
    count=count,
    seed=seed,
    range="3 To 15",
    number=count,
    seed_2=seed,
    value=offset,
    length=point_spacing,
    amplitude=amplitude,
    relay=seed_2)

count_2 = Slider(3, range=0..10)
seed_3 = Slider(475, range=0..1000)
offset_2 = Slider(3, range=0..10)
point_spacing_2 = Slider(1, range=0..1)
amplitude_2 = Slider(0.15, range=0..1)
scale_factor_2 = Slider(0.7, range=0..1)
seed_4 = Slider(3, range=0..10)
radius_2 = Slider(36, range=0..100)
space_filling_curve_2 = SpaceFillingCurve(
    radius=radius_2,
    factor=scale_factor_2,
    count=count_2,
    seed=seed_3,
    range="3 To 15",
    number=count_2,
    seed_2=seed_3,
    value=offset_2,
    length=point_spacing_2,
    amplitude=amplitude_2,
    relay=seed_4)

point_spacing_3 = Slider(1, range=0..1)
amplitude_3 = Slider(0.15, range=0..1)
seed_5 = Slider(4, range=0..10)
offset_3 = Slider(3, range=0..10)
radius_3 = Slider(36, range=0..100)
scale_factor_3 = Slider(0.7, range=0..1)
count_3 = Slider(3, range=0..10)
seed_6 = Slider(475, range=0..1000)
space_filling_curve_3 = SpaceFillingCurve(
    radius=radius_3,
    factor=scale_factor_3,
    count=count_3,
    seed=seed_6,
    range="3 To 15",
    number=count_3,
    seed_2=seed_6,
    value=offset_3,
    length=point_spacing_3,
    amplitude=amplitude_3,
    relay=seed_5)

# ---- group: loft space filling curves
# space filling vase
data_dam = DataDam(DataA=[space_filling_curve, space_filling_curve_2, space_filling_curve_3], BufferDelay=10000000, BufferMode=0)
list_length = ListLength(List=data_dam)
range = Range(Domain="0 To 36", Steps=expr("x-1", list_length))
unit_z = UnitZ(Factor=range)
move = Move(Geometry=data_dam, Motion=unit_z)  # -> Geometry, Transform
loft_options = LoftOptions(Closed=False, Adjust=False, Rebuild=Slider(64, range=0..100), Refit=0, Type=0)
loft = Loft(Curves=move.Geometry, Options=loft_options)

# ==== cluster SpaceFillingCurve
value = ClusterInput()
radius = ClusterInput()
negative = Negative(Value=value)
circle = Circle(Plane=PlaneXY(0, 0, 0), Radius=radius)
boundary_surfaces = BoundarySurfaces(Edges=circle)
factor = ClusterInput()
scale = Scale(Geometry=boundary_surfaces, Center=Point(0, 0, 0), Factor=factor)  # -> Geometry, Transform
offset_curve = OffsetCurve(Curve=circle, Distance=negative, Plane=PlaneXY(0, 0, 0), Corners=1)
count = ClusterInput()
seed = ClusterInput()
range = ClusterInput()
number = ClusterInput()
seed_2 = ClusterInput()
length = ClusterInput()
populate_geometry = PopulateGeometry(Geometry=scale.Geometry, Count=count, Seed=seed)
random = Random(Range=range, Number=number, Seed=seed_2)
divide_length = DivideLength(Curve=offset_curve, Length=length)  # -> simplify(Points), Tangents, Parameters
amplitude = ClusterInput()
circle_2 = Circle(Plane=populate_geometry, Radius=random)
amplitude_2 = Amplitude(Vector=divide_length.Points, Amplitude=amplitude)
boundary_surfaces_2 = BoundarySurfaces(Edges=circle_2)
list_length = ListLength(List=amplitude_2)
relay = ClusterInput()
solid_difference = SolidDifference(BrepsA=boundary_surfaces, BrepsB=boundary_surfaces_2)
random_2 = Random(Range="0 To 2*PI", Number=list_length, Seed=relay)
mesh_surface = MeshSurface(Surface=solid_difference, UCount="100", VCount="100", Overhang=True, Equalize=False)
rotate = Rotate(Geometry=amplitude_2, Angle=random_2, Plane=PlaneXY(0, 0, 0))  # -> simplify(Geometry), Transform
move = Move(Geometry=divide_length.Points, Motion=rotate.Geometry)  # -> Geometry, Transform
pt = Point(move.Geometry)
pt_2 = Point(flatten(pt))
polyline = PolyLine(Vertices=move.Geometry, Closed="True")  # -> flatten(Polyline)
lng = ListLength(List=pt_2)
lng_2 = ListLength(List=pt)  # -> flatten(Length)
series = Series(Start=0, Step=1, Count=lng)
explode = Explode(Curve=polyline, Recursive=True)  # -> Segments, Vertices
line = Line(explode.Segments)
line_2 = Line(flatten(line))
lng_3 = ListLength(List=line_2)
lng_4 = ListLength(List=line)  # -> flatten(Length)
series_2 = Series(Start=0, Step=1, Count=lng_3)
partition = PartitionList(List=series, Size=lng_2)
partition_2 = PartitionList(List=series_2, Size=lng_4)
shift = ShiftList(List=partition, Shift=1, Wrap=True)
shift_2 = ShiftList(List=partition_2, Shift=1, Wrap=True)
int = Integer(flatten(partition))
int_2 = Integer(flatten(shift))
line_3 = Line(flatten(line_2))
point = Point(flatten(pt_2))
int_3 = Integer(flatten(partition_2))
int_4 = Integer(flatten(shift_2))
shift_list = ShiftList(List=explode.Segments, Shift=1, Wrap=True)
length_line = LengthLine(Line=flatten(explode.Segments), Length="6", Strength="10")
show = Show(G=polyline)
angle = Angle(LineA=explode.Segments, LineB=shift_list, RestAngle="0", Strength="1000")
collider = Collider(Objects=point, Radii="2", IgnoreA=int, IgnoreB=int_2, Strength="100")
collider_2 = Collider(Objects=line_3, Radii="0.2", IgnoreA=int_3, IgnoreB=int_4, Strength="100")
onmesh = OnMesh(Points=move.Geometry, Mesh=mesh_surface, Strength="1000")
entwine = Entwine(
    Branch00=show,
    Branch01=onmesh,
    Branch02=length_line,
    Branch03=angle,
    Branch04=collider,
    Branch05=collider_2,
    FlattenInputs=True)
zombiesolver = ZombieSolver(GoalObjects=entwine, Threshold=1e-10, Tolerance=0.01, MaxIterations=50000)  # -> I, V, O
fillet = Fillet(Curve=zombiesolver.O, Radius="20")  # -> flatten(Curve)
join_curves = JoinCurves(Curves=fillet, Preserve=False)
curves = ClusterOutput(join_curves)
