# Grasshopper definition ecological-gradient.gh (Grasshopper 1.0.7)
# plug-ins: Heteroptera

# ----
# particle distribution for forest
timer = Timer(TimerInterval=1000, Target=seed_generator)  # disabled
seed_generator = SeedGenerator(Number=1)
point = Point(Point(0, 0, 0))
point_emitter = PointEmitter(
    Emitter=point,
    Radius=Slider(100, range=0..100),
    Number=Slider(100, range=0..100),
    Tendency=Slider(0.2, range=0..1),
    SeedOptional=seed_generator,
    isflat=True)
