# Grasshopper definition fundamentals.gh (Grasshopper 1.0.7)
# Copyright: GNU General Public License 3.0

# ---- group: point from xyz coordinates
# fundamentals
# point
X = Slider(0, range=0..10)
Y = Slider(0, range=0..10)
Z = Slider(0, range=0..10)
construct_point = ConstructPoint(XCoordinate=X, YCoordinate=Y, ZCoordinate=Z)

# ---- group: point from text panel
point = Point("0,0,0")

# ---- group: line from referenced points
# line
# in the display menu
# turn on gumballs
# to edit these points
# in grasshopper
# right click on each
# point parameter
# to draw the points
# in rhino
point_2 = Point(Point(0, 0, 0))
point_3 = Point(Point(10, 10, 0))
line = Line(StartPoint=point_2, EndPoint=point_3)

# ---- group: mesh from random points
# mesh
number = Slider(9, range=3..100)
seed = Slider(0, range=0..100)
populate_3d = Populate3D(Region={Plane=PlaneXY(0, 0, 0), X=Domain(0, 10), Y=Domain(0, 10), Z=Domain(0, 2)}, Count=number, Seed=seed)
delaunay_mesh = DelaunayMesh(Points=populate_3d, Plane=PlaneXY(0, 0, 0))
mesh_edges = MeshEdges(Mesh=delaunay_mesh)  # -> NakedEdges, InteriorEdges, NonManifoldEdges

# ---- group: surface from random points
# surface
number_2 = Slider(9, range=3..100)
seed_2 = Slider(0, range=0..100)
spans = Slider(20, range=0..100)
populate_3d_2 = Populate3D(Region={Plane=PlaneXY(0, 0, 0), X=Domain(0, 10), Y=Domain(0, 10), Z=Domain(0, 2)}, Count=number_2, Seed=seed_2)
patch = Patch(Points=populate_3d_2, Spans=spans, Flexibility=1, Trim=True)
surface_points = SurfacePoints(Surface=patch)  # -> Points, Weights, Greville, UCount, VCount

# ---- group: point from rhino
# right click on the point parameter
# to set the point position in rhino
point_4 = Point(Point(0, 0, 0))
