# Grasshopper definition noisescape.gh (Grasshopper 1.0.7)
# plug-ins: MeshEdit Components, Noise 4D

# ---- group: simplex noise field
time = Slider(36, range=0..100)
scale = Slider(0.2, range=0..1)
# terrain from noise
extent = Slider(40, range=0..100)
amplitude = Slider(1, range=0..10)
square = Square(Plane=PlaneXY(0, 0, 0), Size=1, ExtentX=extent, ExtentY=extent)  # -> Cells, flatten(Points)
# using 4D noise
simplexnoise = SimplexNoise(Values=square.Points, Time=time, Scale=scale)
multiplication = Multiplication(A=simplexnoise, B=amplitude)
unit_z = UnitZ(Factor=multiplication)
move = Move(Geometry=square.Points, Motion=unit_z)  # -> Geometry, Transform
delaunay_mesh = DelaunayMesh(Points=move.Geometry, Plane=PlaneXY(0, 0, 0))
custom_preview = CustomPreview(Geometry=delaunay_mesh, Material=ColourSwatch(SwatchColor=RGB(230, 230, 230)))

# ---- group: perlin noise field
time_2 = Slider(36, range=0..100)
scale_2 = Slider(0.2, range=0..1)
amplitude_2 = Slider(1, range=0..10)
extent_2 = Slider(40, range=0..100)
square_2 = Square(Plane=PlaneXY(0, 0, 0), Size=1, ExtentX=extent_2, ExtentY=extent_2)  # -> Cells, flatten(Points)
# using 4D noise
perlinnoise = PerlinNoise(Values=square_2.Points, Time=time_2, Scale=scale_2)
multiplication_2 = Multiplication(A=perlinnoise, B=amplitude_2)
unit_z_2 = UnitZ(Factor=multiplication_2)
move_2 = Move(Geometry=square_2.Points, Motion=unit_z_2)  # -> Geometry, Transform
delaunay_mesh_2 = DelaunayMesh(Points=move_2.Geometry, Plane=PlaneXY(0, 0, 0))
custom_preview_2 = CustomPreview(Geometry=delaunay_mesh_2, Material=ColourSwatch(SwatchColor=RGB(230, 230, 230)))

# ---- group: perlin noise gradient
# using meshedit
time_3 = Slider(36, range=0..100)
scale_3 = Slider(0.2, range=0..1)
amplitude_3 = Slider(1, range=0..10)
extent_3 = Slider(39, range=0..100)
square_3 = Square(Plane=PlaneXY(0, 0, 0), Size=1, ExtentX=extent_3, ExtentY=extent_3)  # -> Cells, flatten(Points)
# using 4D noise
perlinnoise_2 = PerlinNoise(Values=square_3.Points, Time=time_3, Scale=scale_3)
multiplication_3 = Multiplication(A=perlinnoise_2, B=amplitude_3)
unit_z_3 = UnitZ(Factor=multiplication_3)
move_3 = Move(Geometry=square_3.Points, Motion=unit_z_3)  # -> Geometry, Transform

# ----
gradient = Gradient(LowerLimit=0, UpperLimit=1, Parameter=multiplication_3, stops=[0: RGB(255, 255, 255), 1: RGB(0, 0, 0)])

# ---- group: perlin noise gradient (continued)
mesh_frompoints = MeshFromPoints(Points=move_3.Geometry, UDirection=expr("x+1", extent_3), VDirection=expr("x+1", extent_3), Colour=gradient)
