# Grasshopper definition space-filling-curve.gh (Grasshopper 1.0.7)
# plug-ins: Pufferfish, Kangaroo2 Components

# ---- group: generate a space filling curve in a circular region / change seed
seed = Slider(2, range=0..10)

# ---- group: generate a space filling curve in a circular region / run & reset
boolean_toggle = BooleanToggle(True)
boolean_toggle_2 = BooleanToggle(False)

# ---- group: generate a space filling curve in a circular region
# space filling curve
radius = Slider(36, range=0..100)
point_spacing = Slider(1, range=0..1)
count = Slider(3, range=0..10)
amplitude = Slider(0.15, range=0..1)
seed_2 = Slider(475, range=0..1000)
offset = Slider(3, range=0..10)
negative = Negative(Value=offset)
circle = Circle(Plane=PlaneXY(0, 0, 0), Radius=radius)
boundary_surfaces = BoundarySurfaces(Edges=circle)
scale = Scale(Geometry=boundary_surfaces, Center=Point(0, 0, 0), Factor="0.7")  # -> Geometry, Transform
offset_curve = OffsetCurve(Curve=circle, Distance=negative, Plane=PlaneXY(0, 0, 0), Corners=1)
populate_geometry = PopulateGeometry(Geometry=scale.Geometry, Count=count, Seed=seed_2)
random = Random(Range="3 To 15", Number=count, Seed=seed_2)
divide_length = DivideLength(Curve=offset_curve, Length=point_spacing)  # -> simplify(Points), Tangents, Parameters
circle_2 = Circle(Plane=populate_geometry, Radius=random)
amplitude_2 = Amplitude(Vector=divide_length.Points, Amplitude=amplitude)
boundary_surfaces_2 = BoundarySurfaces(Edges=circle_2)
list_length = ListLength(List=amplitude_2)
solid_difference = SolidDifference(BrepsA=boundary_surfaces, BrepsB=boundary_surfaces_2)
random_2 = Random(Range="0 To 2*PI", Number=list_length, Seed=seed)
mesh_surface = MeshSurface(Surface=solid_difference, UCount="100", VCount="100", Overhang=True, Equalize=False)
rotate = Rotate(Geometry=amplitude_2, Angle=random_2, Plane=PlaneXY(0, 0, 0))  # -> simplify(Geometry), Transform
move = Move(Geometry=divide_length.Points, Motion=rotate.Geometry)  # -> Geometry, Transform
pt = Point(move.Geometry)
pt_2 = Point(flatten(pt))
polyline = PolyLine(Vertices=move.Geometry, Closed="True")  # -> flatten(Polyline)
lng = ListLength(List=pt_2)
lng_2 = ListLength(List=pt)  # -> flatten(Length)
series = Series(Start=0, Step=1, Count=lng)
explode = Explode(Curve=polyline, Recursive=True)  # -> Segments, Vertices
line = Line(explode.Segments)
line_2 = Line(flatten(line))
lng_3 = ListLength(List=line_2)
lng_4 = ListLength(List=line)  # -> flatten(Length)
series_2 = Series(Start=0, Step=1, Count=lng_3)
partition = PartitionList(List=series, Size=lng_2)
partition_2 = PartitionList(List=series_2, Size=lng_4)
shift = ShiftList(List=partition, Shift=1, Wrap=True)
shift_2 = ShiftList(List=partition_2, Shift=1, Wrap=True)
int = Integer(flatten(partition))
int_2 = Integer(flatten(shift))
line_3 = Line(flatten(line_2))
point = Point(flatten(pt_2))
int_3 = Integer(flatten(partition_2))
int_4 = Integer(flatten(shift_2))
shift_list = ShiftList(List=explode.Segments, Shift=1, Wrap=True)
length_line = LengthLine(Line=flatten(explode.Segments), Length="6", Strength="10")
show = Show(G=polyline)
angle = Angle(LineA=explode.Segments, LineB=shift_list, RestAngle="0", Strength="1000")
collider = Collider(Objects=point, Radii="2", IgnoreA=int, IgnoreB=int_2, Strength="100")
collider_2 = Collider(Objects=line_3, Radii="0.2", IgnoreA=int_3, IgnoreB=int_4, Strength="100")
onmesh = OnMesh(Points=move.Geometry, Mesh=mesh_surface, Strength="1000")
entwine = Entwine(
    Branch00=show,
    Branch01=onmesh,
    Branch02=length_line,
    Branch03=angle,
    Branch04=collider,
    Branch05=collider_2,
    FlattenInputs=True)
solver = Solver(GoalObjects=entwine, Reset=boolean_toggle_2, Threshold=1e-15, Tolerance=0.01, On=boolean_toggle)  # -> I, V, O
fillet = Fillet(Curve=solver.O, Radius="20")  # -> flatten(Curve)
join_curves = JoinCurves(Curves=fillet, Preserve=False)

# ---- group: extrude curves
line_4 = Line(StartPoint="0,0,0", EndPoint="0,0,6")
extrude_linear = ExtrudeLinear(Profile=join_curves, OrientationP=PlaneXY(0, 0, 0), Axis=line_4)
offset_surface = OffsetSurface(Surface=extrude_linear, Distance=Slider(2, range=0..10), BothSides=False, CreateSolid=True)
