# Grasshopper definition terrain-modeling.gh (Grasshopper 1.0.7)
# plug-ins: Docofossor

# ---- group: import xyz data as grid
# import terrain
# using docofossor
file_path = FilePath("D:\generative-design\grasshopper\data\elevation.xyz")
import_xyz = ImportXYZ(F=file_path, N="2")
grid_shift = GridShift(Df=import_xyz)
grid_mesh = GridMesh(Df=grid_shift)

# ----
area = Area(Geometry=grid_mesh)  # -> Area, Centroid
xz_plane = XZPlane(Origin=area.Centroid)
mirror = Mirror(Geometry=grid_mesh, Plane=xz_plane)  # -> Geometry, Transform

# ---- group: import xyz data as grid (continued)
custom_preview = CustomPreview(Geometry=mirror.Geometry, Material=ColourSwatch(SwatchColor=RGB(230, 230, 230)))
