# Grasshopper definition trigonometry-basics.gh (Grasshopper 1.0.7)
# Copyright: GNU General Public License 3.0

# ---- group: sine curve
# trigonometry basics
# curves
u = Slider(2, range=0..10)
pi = Pi(Factor=u)
range = Range(Domain=pi, Steps=1000)
sine = Sine(Value=range)
construct_point = ConstructPoint(XCoordinate=range, YCoordinate=sine, ZCoordinate=0)
interpolate = Interpolate(Vertices=construct_point, Degree=3, Periodic=False, KnotStyle=1)  # -> Curve, Length, Domain
curve = Curve(interpolate.Curve)

# ---- group: translated sine curve
# translation
u_2 = Slider(2, range=0..10)
a = Slider(1.5, range=0..10)
b = Slider(1, range=0..10)
pi_2 = Pi(Factor=u_2)
range_2 = Range(Domain=pi_2, Steps=1000)
sine_2 = Sine(Value=range_2)
addition = Addition(A=range_2, B=a)
addition_2 = Addition(A=sine_2, B=b)
construct_point_2 = ConstructPoint(XCoordinate=addition, YCoordinate=addition_2, ZCoordinate=0)
interpolate_2 = Interpolate(Vertices=construct_point_2, Degree=3, Periodic=False, KnotStyle=1)  # -> Curve, Length, Domain
curve_2 = Curve(interpolate_2.Curve)

# ---- group: scaled sine curve
# scaling
u_3 = Slider(2, range=0..10)
r = Slider(0.5, range=-2..2)
pi_3 = Pi(Factor=u_3)
range_3 = Range(Domain=pi_3, Steps=100)
sine_3 = Sine(Value=range_3)
multiplication = Multiplication(A=range_3, B=r)
multiplication_2 = Multiplication(A=sine_3, B=r)
construct_point_3 = ConstructPoint(XCoordinate=multiplication, YCoordinate=multiplication_2, ZCoordinate=0)
interpolate_3 = Interpolate(Vertices=construct_point_3, Degree=3, Periodic=False, KnotStyle=1)  # -> Curve, Length, Domain
curve_3 = Curve(interpolate_3.Curve)

# ---- group: cut sine curve
# cutting
u_4 = Slider(1, range=0..10)
pi_4 = Pi(Factor=u_4)
range_4 = Range(Domain=pi_4, Steps=100)
sine_4 = Sine(Value=range_4)
construct_point_4 = ConstructPoint(XCoordinate=range_4, YCoordinate=sine_4, ZCoordinate=0)
interpolate_4 = Interpolate(Vertices=construct_point_4, Degree=3, Periodic=False, KnotStyle=1)  # -> Curve, Length, Domain
curve_4 = Curve(interpolate_4.Curve)

# ---- group: amplitude of sine curve
# amplitude
u_5 = Slider(2, range=0..10)
A = Slider(2, range=0..10)
pi_5 = Pi(Factor=u_5)
range_5 = Range(Domain=pi_5, Steps=1000)
sine_5 = Sine(Value=range_5)
multiplication_3 = Multiplication(A=sine_5, B=A)
construct_point_5 = ConstructPoint(XCoordinate=range_5, YCoordinate=multiplication_3, ZCoordinate=0)
interpolate_5 = Interpolate(Vertices=construct_point_5, Degree=3, Periodic=False, KnotStyle=1)  # -> Curve, Length, Domain
curve_5 = Curve(interpolate_5.Curve)

# ---- group: dampened sine curve
# dampening
u_6 = Slider(2, range=0..10)
h = Slider(2, range=0..10)
pi_6 = Pi(Factor=u_6)
range_6 = Range(Domain=pi_6, Steps=1000)
sine_6 = Sine(Value=range_6)
division = Division(A=range_6, B=h)
power = Power(A="0.5", B=division)
multiplication_4 = Multiplication(A=sine_6, B=power)
construct_point_6 = ConstructPoint(XCoordinate=range_6, YCoordinate=multiplication_4, ZCoordinate=0)
interpolate_6 = Interpolate(Vertices=construct_point_6, Degree=3, Periodic=False, KnotStyle=1)  # -> Curve, Length, Domain
curve_6 = Curve(interpolate_6.Curve)

# ---- group: sine curve using expression
# expressions
domain = Slider(20, range=0..100)
steps = Slider(1000, range=0..1000)
wavelength = Slider(2, range=0..10)
amplitude = Slider(1, range=0..10)
range_7 = Range(Domain=domain, Steps=steps)
expression = Expression(x=range_7, w=wavelength, a=amplitude, Expression="a*sin(2*π*x/w)")
construct_point_7 = ConstructPoint(XCoordinate=range_7, YCoordinate=expression, ZCoordinate=0)
interpolate_7 = Interpolate(Vertices=construct_point_7, Degree=3, Periodic=False, KnotStyle=1)  # -> Curve, Length, Domain
curve_7 = Curve(interpolate_7.Curve)

# ---- group: sine curve with decay function
# decay function
domain_2 = Slider(20, range=0..100)
steps_2 = Slider(1000, range=0..1000)
wavelength_2 = Slider(2, range=0..10)
amplitude_2 = Slider(2, range=0..10)
halflife = Slider(2, range=0..10)
range_8 = Range(Domain=domain_2, Steps=steps_2)
expression_2 = Expression(x=range_8, w=wavelength_2, a=amplitude_2, h=halflife, Expression="1/2^(x/h)*a*sin(2*π*x/w)")
construct_point_8 = ConstructPoint(XCoordinate=range_8, YCoordinate=expression_2, ZCoordinate=0)
interpolate_8 = Interpolate(Vertices=construct_point_8, Degree=3, Periodic=False, KnotStyle=1)  # -> Curve, Length, Domain
curve_8 = Curve(interpolate_8.Curve)

# ---- group: sine curve using expression
domain_3 = Slider(20, range=0..100)
steps_3 = Slider(1000, range=0..1000)
frequency = Slider(0.5, range=0..3)
phase = Slider(0, range=0..10)
amplitude_3 = Slider(2, range=0..10)
range_9 = Range(Domain=domain_3, Steps=steps_3)
expression_3 = Expression(x=range_9, f=frequency, p=phase, a=amplitude_3, Expression="a*sin(2*π*x*f+p)")
construct_point_9 = ConstructPoint(XCoordinate=range_9, YCoordinate=expression_3, ZCoordinate=0)
interpolate_9 = Interpolate(Vertices=construct_point_9, Degree=3, Periodic=False, KnotStyle=1)  # -> Curve, Length, Domain
curve_9 = Curve(interpolate_9.Curve)

# ---- group: circle from trigonometry
# t -> center + cos(t)*radius*xaxis + sin(t)*radius*yaxis
panel = Panel("2")
radius = Slider(2, range=0..10)
center_x = Slider(2, range=0..10)
radius_2 = Number(radius)
center_y = Slider(2, range=0..10)
pi_7 = Pi(Factor=panel)
pi_8 = Pi(Factor="2")
range_10 = Range(Domain=pi_7, Steps=10)
range_11 = Range(Domain=pi_8, Steps=10)
sine_7 = Sine(Value=range_10)
cosine = Cosine(Value=range_11)
multiplication_5 = Multiplication(A=sine_7, B=radius)
multiplication_6 = Multiplication(A=cosine, B=radius_2)
addition_3 = Addition(A=multiplication_5, B=center_x)
addition_4 = Addition(A=multiplication_6, B=center_y)
construct_point_10 = ConstructPoint(XCoordinate=addition_3, YCoordinate=addition_4, ZCoordinate=0)
interpolate_10 = Interpolate(Vertices=construct_point_10, Degree=3, Periodic=False, KnotStyle=1)  # -> Curve, Length, Domain
curve_10 = Curve(interpolate_10.Curve)

# ---- group: sine curve
# y(t) = amplitude*sin(frequency*t + phase)
time = Slider(6, range=0..10)
steps_4 = Slider(100, range=0..100)
frequency_2 = Slider(1, range=0..3)
phase_2 = Slider(0, range=0..10)
amplitude_4 = Slider(2, range=0..2)
pi_9 = Pi(Factor=time)
range_12 = Range(Domain=pi_9, Steps=steps_4)
multiplication_7 = Multiplication(A=range_12, B=frequency_2)
addition_5 = Addition(A=multiplication_7, B=phase_2)
sine_8 = Sine(Value=addition_5)
multiplication_8 = Multiplication(A=sine_8, B=amplitude_4)
construct_point_11 = ConstructPoint(XCoordinate=range_12, YCoordinate=0, ZCoordinate=multiplication_8)
interpolate_11 = Interpolate(Vertices=construct_point_11, Degree=3, Periodic=False, KnotStyle=1)  # -> Curve, Length, Domain
curve_11 = Curve(interpolate_11.Curve)

# ---- group: unit circle
# circles
u_7 = Slider(2, range=0..10)
pi_10 = Pi(Factor=u_7)
range_13 = Range(Domain=pi_10, Steps=1000)
sine_9 = Sine(Value=range_13)
cosine_2 = Cosine(Value=range_13)
construct_point_12 = ConstructPoint(XCoordinate=sine_9, YCoordinate=cosine_2, ZCoordinate=0)
interpolate_12 = Interpolate(Vertices=construct_point_12, Degree=3, Periodic=False, KnotStyle=1)  # -> Curve, Length, Domain
curve_12 = Curve(interpolate_12.Curve)

# ---- group: translated circle
# translation
u_8 = Slider(2, range=0..10)
a_2 = Slider(1, range=0..10)
b_2 = Slider(1, range=0..10)
pi_11 = Pi(Factor=u_8)
range_14 = Range(Domain=pi_11, Steps=1000)
cosine_3 = Cosine(Value=range_14)
sine_10 = Sine(Value=range_14)
addition_6 = Addition(A=sine_10, B=a_2)
addition_7 = Addition(A=cosine_3, B=b_2)
construct_point_13 = ConstructPoint(XCoordinate=addition_6, YCoordinate=addition_7, ZCoordinate=0)
interpolate_13 = Interpolate(Vertices=construct_point_13, Degree=3, Periodic=False, KnotStyle=1)  # -> Curve, Length, Domain
curve_13 = Curve(interpolate_13.Curve)

# ---- group: scaled circle
# scaling
u_9 = Slider(2, range=0..10)
r_2 = Slider(0.5, range=-2..2)
pi_12 = Pi(Factor=u_9)
range_15 = Range(Domain=pi_12, Steps=100)
sine_11 = Sine(Value=range_15)
cosine_4 = Cosine(Value=range_15)
multiplication_9 = Multiplication(A=sine_11, B=r_2)
multiplication_10 = Multiplication(A=cosine_4, B=r_2)
construct_point_14 = ConstructPoint(XCoordinate=multiplication_9, YCoordinate=multiplication_10, ZCoordinate=0)
interpolate_14 = Interpolate(Vertices=construct_point_14, Degree=3, Periodic=False, KnotStyle=1)  # -> Curve, Length, Domain
curve_14 = Curve(interpolate_14.Curve)

# ---- group: cut circle
# cutting
u_10 = Slider(1, range=0..10)
pi_13 = Pi(Factor=u_10)
range_16 = Range(Domain=pi_13, Steps=100)
sine_12 = Sine(Value=range_16)
cosine_5 = Cosine(Value=range_16)
construct_point_15 = ConstructPoint(XCoordinate=sine_12, YCoordinate=cosine_5, ZCoordinate=0)
interpolate_15 = Interpolate(Vertices=construct_point_15, Degree=3, Periodic=False, KnotStyle=1)  # -> Curve, Length, Domain
curve_15 = Curve(interpolate_15.Curve)

# ---- group: cosine curve
u_11 = Slider(2, range=0..10)
pi_14 = Pi(Factor=u_11)
range_17 = Range(Domain=pi_14, Steps=1000)

# ----
cosine_6 = Cosine(Value=range_17)

# ---- group: cosine curve (continued)
construct_point_16 = ConstructPoint(XCoordinate=range_17, YCoordinate=cosine_6, ZCoordinate=0)
interpolate_16 = Interpolate(Vertices=construct_point_16, Degree=3, Periodic=False, KnotStyle=1)  # -> Curve, Length, Domain
curve_16 = Curve(interpolate_16.Curve)

# ---- group: modulated sine curve
# modulation
u_12 = Slider(2, range=0..10)
w = Slider(0.5, range=0..10)
pi_15 = Pi(Factor=u_12)
range_18 = Range(Domain=pi_15, Steps=1000)

# ----
division_2 = Division(A=range_18, B=w)

# ---- group: modulated sine curve (continued)
sine_13 = Sine(Value=division_2)
construct_point_17 = ConstructPoint(XCoordinate=range_18, YCoordinate=sine_13, ZCoordinate=0)
interpolate_17 = Interpolate(Vertices=construct_point_17, Degree=3, Periodic=False, KnotStyle=1)  # -> Curve, Length, Domain
curve_17 = Curve(interpolate_17.Curve)
