# Grasshopper definition ur10e.gh (Grasshopper 1.0.7)
# plug-ins: Robots

# ---- group: robot system
list = ValueList({"Bartlett-IRB120", "Bartlett-IRB1600", "Bartlett-KR6", "Bartlett-KR60-A", "Bartlett-KR60-B", "Bartlett-KR500", "Bartlett-KR60 on track", "Bartlett-UR10", "Bartlett-KR60", "Bartlett-TX200", "Bartlett-TX200L", "Bartlett-RX160", "Bartlett-RX160L", "CITA-IRB1600-145 + Turntable", "CITA-IRB1600-145 + IRB140", "CITA-IRB1600-145", "CITA-IRB140", "CITA-UR5e", "UR5e", "UR10e"}, selected="UR10e")
load_robot_system = LoadRobotSystem(Name=list, Base="0,0,240")

# ----
create_program = CreateProgram(Name="program", RobotSystem=load_robot_system, StepSize=1)  # -> Program, Code, Duration, Warnings, Errors
filepath = Panel("D:\rhino\grasshopper")
robot_program = Panel(create_program.Program)

# ---- group: preview
# Right click and select 'open controls' to
# preview the tool path, or move the slider.
number_slider = Slider(0, range=0..1)
sim = ProgramSimulation(Program=create_program.Program, Time=number_slider, Normalized=True)  # -> SystemMeshes, JointRotations, Plane, Index, Time, Program, Errors
trail = SimpleTrail(Program=sim.Program, Length=1000, MechanicalGroup=0)

# ----
relay = Relay()

# ---- group: save program to file
# Enable this component to save
#  the program to a file.
panel = Panel("C:\Users\baharmon\Documents\Robots\scripts")
saveprog = SaveProgram(Program=relay, Folder=panel)  # disabled

# ----
time = Panel(sim.Time)
